# Grasshopper definition mesh tester 2.gh (Grasshopper 0.9.75)
# plug-ins: GHva3c, LunchBox

panel = Panel("""Jonatan
Charlie
Ben""")
panel_2 = Panel("""true
1123
3.142""")
klein = KleinSurface(
    UDivisions=96,
    VDivisions=91,
    RParameter=3,
    TParameter=0.5,
    Scale=Slider(5000, range=0..10000),
    Domain1=Domain(0, 12.56637061),
    Domain2=Domain(0, 3.141592654))
mesh_uv = MeshSurface(Surface=klein, UCount=Slider(100, range=0..100), VCount=Slider(30, range=0..100), Overhang=True, Equalize=False)
tri = Triangulate(Mesh=mesh_uv)  # -> Mesh, Count
va3c_geometry = Va3c_geometry(Mesh=tri.Mesh, AttributeNames=panel, AttributeValues=panel_2)
creatematerial = CreateMaterial(Color=ColourSwatch(SwatchColor=RGB(67, 255, 255)))
va3c_scene = Va3c_Scene(Write=Toggle(False), FilePath="C:\Users\bh\Desktop\DrCyanKlein.json", MeshGeo=va3c_geometry, Materials=creatematerial)
panel_3 = Panel(va3c_scene)
